# Dynamo graph NodeIconGenerator.dyn (Dynamo 1.3.2.2480)

file_path = Filename("D:\Source\Repos\rhythm_for_dynamo\Rhythm\Resources\[replace].Small.png")
fromPath = FileObject(file_path)  # "File.FromPath"
string = StringInput("D:\Source\Repos\rhythm_for_dynamo\Rhythm\Resources\newOnes\")
file_path_2 = Filename("C:\Users\JohnPierson\AppData\Roaming\Dynamo\Dynamo Revit\1.3\packages\Rhythm\bin\Rhythm.XML")
fromPath_2 = FileObject(file_path_2)  # "File.FromPath"
readText = File.ReadText(fromPath_2)
string_2 = StringInput("<member name=\"M:")
string_3 = StringInput("\">")
split = String.Split(readText, string_2, string_3)
code_block = CodeBlock { "Rhythm.Revit"; }
startsWith = String.StartsWith(str=split, searchFor=code_block)
filterByBoolMask = List.FilterByBoolMask(list=split, mask=startsWith)
code_block_2 = CodeBlock { "("; }
split_2 = String.Split(filterByBoolMask.in, code_block_2)
firstItem = List.FirstItem(split_2@L2)
string_4 = StringInput(".Small.png")
code_block_3 = CodeBlock(x=string, y=firstItem, z=string_4) { x+y+z; }
copy = File.Copy(fromPath, code_block_3)
