# Dynamo custom node Arrowhead Assigner.dyf (Dynamo 1.3.3.4651)
# category: Rhythm.Tools
# This node assings the arrowhead type for all text and keynote tags. There is an input for ones you want to exclude.

element_types = ElementTypes("TextNoteType")
all_elements_of_type = ElementsOfType(element_types)
convertTextNotes = Input(convertTextNotes : bool=false)

# group: Text Notes
toggle = Rhythm.Revit.Helpers.Helpers.Toggle(all_elements_of_type, convertTextNotes)

# group: Collects tag types
python_script = Python()  # unwired: IN[0]
# ---------- python_script.python (36 lines) ----------
#Copyright(c) 2017, john pierson
# @60secondrevit, http://sixtysecondrevit.com

import clr
clr.AddReference('ProtoGeometry')
from Autodesk.DesignScript.Geometry import *

# Import DocumentManager and TransactionManager
clr.AddReference("RevitServices")
import RevitServices
from RevitServices.Persistence import DocumentManager
from RevitServices.Transactions import TransactionManager

# Import RevitAPI
clr.AddReference("RevitAPI")
import Autodesk
from Autodesk.Revit.DB import *

doc = DocumentManager.Instance.CurrentDBDocument
uiapp = DocumentManager.Instance.CurrentUIApplication
app = uiapp.Application

from System.Collections.Generic import *


#The inputs to this node will be stored as a list in the IN variable.
dataEnteringNode = IN
collector = FilteredElementCollector(doc)
tags = collector.OfClass(FamilySymbol).ToElements()

tagFamilies = []
for i in tags:
	if i.Category.Name.Contains("Tag"):
		tagFamilies.append(i)

OUT = tagFamilies
# ----------------------------------------
getCategory = Element.GetCategory(python_script)
name = Element.Name(getCategory)
groupByKey = List.GroupByKey(list=python_script, keys=name)

# group: Keynote Tags
code_block = CodeBlock { "Keynote Tags"; }
indexOf = IndexOf(groupByKey.unique_keys, code_block)
getItemAtIndex = List.GetItemAtIndex(list=groupByKey.groups, index=indexOf)

convertKeynoteTags = Input(convertKeynoteTags : bool=false)

# group: Keynote Tags
toggle_2 = Rhythm.Revit.Helpers.Helpers.Toggle(getItemAtIndex, convertKeynoteTags)

# group: Room Tags
code_block_2 = CodeBlock { "Room Tags"; }
indexOf_2 = IndexOf(groupByKey.unique_keys, code_block_2)
getItemAtIndex_2 = List.GetItemAtIndex(list=groupByKey.groups, index=indexOf_2)

convertRoomTags = Input(convertRoomTags : bool=false)

# group: Room Tags
toggle_3 = Rhythm.Revit.Helpers.Helpers.Toggle(getItemAtIndex_2, convertRoomTags)

# group: Door Tags
code_block_3 = CodeBlock { "Door Tags"; }
indexOf_3 = IndexOf(groupByKey.unique_keys, code_block_3)
getItemAtIndex_3 = List.GetItemAtIndex(list=groupByKey.groups, index=indexOf_3)

convertDoorTags = Input(convertDoorTags : bool=false)

# group: Door Tags
toggle_4 = Rhythm.Revit.Helpers.Helpers.Toggle(getItemAtIndex_3, convertDoorTags)

# group: Window Tags
code_block_4 = CodeBlock { "Window Tags"; }
indexOf_4 = IndexOf(groupByKey.unique_keys, code_block_4)
getItemAtIndex_4 = List.GetItemAtIndex(list=groupByKey.groups, index=indexOf_4)

convertWindowTags = Input(convertWindowTags : bool=false)

# group: Window Tags
toggle_5 = Rhythm.Revit.Helpers.Helpers.Toggle(getItemAtIndex_4, convertWindowTags)

# group: Wall Tags
code_block_5 = CodeBlock { "Wall Tags"; }
indexOf_5 = IndexOf(groupByKey.unique_keys, code_block_5)
getItemAtIndex_5 = List.GetItemAtIndex(list=groupByKey.groups, index=indexOf_5)

convertWallTags = Input(convertWallTags : bool=false)

# group: Wall Tags
toggle_6 = Rhythm.Revit.Helpers.Helpers.Toggle(getItemAtIndex_5, convertWallTags)

code_block_6 = CodeBlock(a=toggle, b=toggle_2, c=toggle_3, d=toggle_4, e=toggle_5, f=toggle_6) { Flatten({a,b,c,d,e,f}); }
RunMe = Input(RunMe : bool=false)

# group: RunMe
toggle_7 = Rhythm.Revit.Helpers.Helpers.Toggle(code_block_6, RunMe)

string = StringInput("Leader Arrowhead")
arrowheadType = Input(arrowheadType : string)

# group: Gets the arrowhead type
element_types_2 = ElementTypes("ElementType")
all_elements_of_type_2 = ElementsOfType(element_types_2)
name_2 = Element.Name(all_elements_of_type_2)
indexOf_6 = IndexOf(name_2, arrowheadType)
getItemAtIndex_6 = List.GetItemAtIndex(list=all_elements_of_type_2, index=indexOf_6)

setParameterByName = Element.SetParameterByName(element=toggle_7, parameterName=string, value=getItemAtIndex_6)
element = Output(setParameterByName)
code_block_7 = CodeBlock {  }
