# Dynamo custom node Ayuda.ThisOrThat.dyf (Dynamo 0.8.1.1823)
# category: Rhythm.Core.Ayuda
# This node is a toggle between two inputs.

Item1 = Input(Item1 : var[]..[])
Item2 = Input(Item2 : var[]..[])
create = List.Create(Item1, Item2)
Toggle = Input(Toggle : bool)
code_block = CodeBlock { 0; 1; }
if_ = If(test=Toggle, true=code_block.out0, false=code_block.out1)
getItemAtIndex = List.GetItemAtIndex(list=create, index=if_)
var = Output(getItemAtIndex)  # "var[]..[]"
