# Dynamo custom node Collector.KeynoteTags.dyf (Dynamo 0.9.0.3067)
# category: Rhythm.Revit.Selection
# This collects all of the keynote tags in the model. Similar to other nodes, but this doesn't use python.

element_types = ElementTypes("FamilySymbol")
# note: Sets the leader arrowhead for all keynote tags
all_elements_of_type = ElementsOfType(element_types)
RunMe = Input(RunMe : bool = false)
toggle = Custom[Rhythm.Toggle](list=all_elements_of_type, boolean=RunMe)  # Toggle that offers two outputs. Created for Dynamo 0.8.1 because of changes to the "IF" node
category = Custom[Element.Category](element=toggle.in)  # This node will get the input element(s)' categories
code_block = CodeBlock { "Keynote Tags"; }
eq = category == code_block
filterByBoolMask = List.FilterByBoolMask(list=toggle.in, mask=eq)
Keynote_Tags = Output(filterByBoolMask.in)
