# Dynamo custom node Collector.LabelTypes.dyf (Dynamo 1.2.1.3083)
# category: Rhythm.Revit.Collector
# This node collects all of the label types for the active family document.

element_types = ElementTypes("TextElement")
all_elements_of_type = ElementsOfType(element_types)
RunMe = Input(RunMe : bool = false)
toggle = Custom[Rhythm.Toggle](list=all_elements_of_type, boolean=RunMe)  # Toggle that offers two outputs. Created for Dynamo 0.8.1 because of changes to the "IF" node
type = Custom[Element.Type](element=toggle.in)  # This retrieves the element type of the given elements. (if available) Similar to others available but no python here.
string_from_object = FromObject(type)
code_block = CodeBlock { "Element"; }
contains = String.Contains(str=string_from_object, searchFor=code_block)
filterByBoolMask = List.FilterByBoolMask(list=type, mask=contains)
LabelTypes = Output(filterByBoolMask.in)
name = Element.Name(filterByBoolMask.in)
LabelTypeNames = Output(name)
