# Dynamo custom node Dimension.UsesProjectSettings.dyf (Dynamo 1.3.2.2480)
# category: Rhythm.Revit.Elements.Dimension
# This will determine if a dimension uses project settings.

dimension = Input()
code_block = CodeBlock(item=dimension) { DSCore.List.Flatten({item},-1); }

# group: This figures out if we are being given types or instances.
string_from_object = FromObject(code_block)
code_block_2 = CodeBlock { "Type"; }
contains = String.Contains(str=string_from_object, searchFor=code_block_2)
getParameterValueByName = Element.GetParameterValueByName(element=code_block, parameterName=code_block_2)
if_ = If(test=contains, true=code_block, false=getParameterValueByName)

python_script = Python(IN[0]=if_)
# ---------- python_script.python (24 lines) ----------
#Copyright(c) 2017, john pierson
# @60secondrevit, http://sixtysecondrevit.com
import clr
clr.AddReference('ProtoGeometry')
from Autodesk.DesignScript.Geometry import *

from System.Collections.Generic import *
# Import RevitAPI
clr.AddReference("RevitAPI")
import Autodesk

#unwrap all elements to use with API
dims = UnwrapElement(IN[0])

#Figure out if the dim type uses default and append true/false to list
formatOptions = list()
for i in dims:
	try:
		formatOptions.append(i.GetUnitsFormatOptions().UseDefault)		
	except:
		formatOptions.append(list())
		
#Assign your output to the OUT variable
OUT = formatOptions
# ----------------------------------------
filterByBoolMask = List.FilterByBoolMask(list=if_, mask=python_script)
overriddenSettings = Output(filterByBoolMask.out)
usesProjectSettings = Output(filterByBoolMask.in)
