# Dynamo custom node Element.AreaLocation.dyf (Dynamo 1.2.0.2690)
# category: Rhythm.Revit.Elements.Element
# This node will determine what area (area plans) an element is located within. Made possible thanks to clockwork. :)

categories = Categories("Areas")
all_elements_of_category = ElementsOfCategory(categories)
areaType = Input(areaType : string ="")  # specify area type to collect. leave blank for all areas.

# group: Added to be able to specify area type to check.
string = StringInput("")
eq = string == areaType
code_block = CodeBlock { "Area Type"; }
getParameterValueByName = Element.GetParameterValueByName(element=all_elements_of_category, parameterName=code_block)
code_block_2 = CodeBlock(items=getParameterValueByName) { List.Cycle(true,Count(items)); }
eq_2 = getParameterValueByName == areaType
if_ = If(test=eq, true=code_block_2, false=eq_2)
filterByBoolMask = List.FilterByBoolMask(list=all_elements_of_category, mask=if_)

RunMe = Input(RunMe : bool = false)  # This is a toggle. Use a boolean to make this node run.
toggle = Custom[Rhythm.Toggle](list=filterByBoolMask.in, boolean=RunMe)  # Toggle that offers two outputs. Created for Dynamo 0.8.1 because of changes to the "IF" node
code_block_3 = CodeBlock { 1; }
chop = List.Chop(list=toggle.in, lengths=code_block_3)
element = Input()
code_block_4 = CodeBlock(element=element) { element; }
getLocation = Element.GetLocation(code_block_4)
count = Count(getLocation)
cycle = List.Cycle(list=chop, amount=count, lacing=Longest)

# group: Room.Boundaries from Clockwork. All credit goes to Andreas Dieckmann.
code_block_5 = CodeBlock(item=toggle.in) { Flatten({item}); }
python_script = Python(IN[0]=code_block_5)
# ---------- python_script.python (42 lines) ----------
import clr
clr.AddReference('RevitAPI')
from Autodesk.Revit.DB import *
import Autodesk

clr.AddReference("RevitNodes")
import Revit
clr.ImportExtensions(Revit.GeometryConversion)

items = UnwrapElement(IN[0])
elementlist = list()
curvelist = list()

for item in items:
	doc = item.Document
	calculator = SpatialElementGeometryCalculator(doc)
	options = Autodesk.Revit.DB.SpatialElementBoundaryOptions()
	# get boundary location from area computation settings
	boundloc = Autodesk.Revit.DB.AreaVolumeSettings.GetAreaVolumeSettings(doc).GetSpatialElementBoundaryLocation(SpatialElementType.Room)
	options.SpatialElementBoundaryLocation = boundloc
	#method #1 - get boundary segments
	blist = list()
	clist = list()
	try:
		for boundarylist in item.GetBoundarySegments(options):
			for boundary in boundarylist:
				blist.append(boundary.Element)
				clist.append(boundary.Curve.ToProtoType())
	except:
		pass
	#method #2 - spatial element geometry calculator
	try:
		results = calculator.CalculateSpatialElementGeometry(item)
		for face in results.GetGeometry().Faces:
			for bface in results.GetBoundaryFaceInfo(face):
				blist.append(doc.GetElement(bface.SpatialBoundaryElement.HostElementId))
	except:
		pass	
	# write results to list
	elementlist.append(blist)
	curvelist.append(clist)
OUT = (elementlist,curvelist)
# ----------------------------------------
code_block_6 = CodeBlock(boundaries=python_script) { boundaries[1]; }

byJoinedCurves = PolyCurve.ByJoinedCurves(code_block_6)
code_block_7 = CodeBlock { 0..1..#100; }
pointAtParameter = Curve.PointAtParameter(curve=byJoinedCurves, param=code_block_7, lacing=CrossProduct)
code_block_8 = CodeBlock { 1; }
flatten = List.Flatten(list=pointAtParameter@L2, amt=code_block_8)
byPoints = Polygon.ByPoints(flatten)
containmentTest = Polygon.ContainmentTest(byPoints, getLocation, lacing=CrossProduct)
filterByBoolMask_2 = List.FilterByBoolMask(list=cycle, mask=containmentTest)
flatten_2 = Flatten(filterByBoolMask_2.in)
area_location = Output(flatten_2)
