# Dynamo custom node Element.GetMultipleParameterValuesByName.dyf (Dynamo 0.8.2.2392)
# category: Rhythm.Revit.Elements.Element.Actions
# Get the value of multiple parameters from elements. (Seperate parameters with comma)

parameterNames = Input(parameterNames : string)
code_block = CodeBlock { ","; }
split = String.Split(parameterNames, code_block)
parameterNames_2 = Output(split)  # "parameterNames"
Elements = Input()
flatten = Flatten(split)
code_block_2 = CodeBlock(in1=Elements, in2=flatten) { in1<1>.GetParameterValueByName(in2<2>); }
var = Output(code_block_2)  # "var[]..[]"
