# Dynamo custom node Element.GetParameterValueByName(CaSe iNSeNSiTive).dyf (Dynamo 0.8.2.2392)
# category: Rhythm.Revit.Elements.Element
# Get the value of one of the element's parameters. (CaSe iNSeNSiTiVe)

element = Input(element : Element)

# group: This retireves all of the elements parameters.
parameters = Element.Parameters(element)
name = Parameter.Name(parameters)

parameterName = Input(parameterName : string)

# group: This matches your input parameter to the queried values
toLower = String.ToLower(name)
toLower_2 = String.ToLower(parameterName)
eq = toLower == toLower_2
filterByBoolMask = List.FilterByBoolMask(list=name, mask=eq)
uniqueItems = List.UniqueItems(filterByBoolMask.in)
getParameterValueByName = Element.GetParameterValueByName(element=element, parameterName=uniqueItems)

clean = Custom[Output.Clean](input=getParameterValueByName)  # This will return a single value or list from one input.
Element = Output(clean)
