# Dynamo custom node Element.ParentFamily.dyf (Dynamo 0.9.2.4472)
# category: Rhythm.Revit.Elements.Element
# This node retrieces the parent family name for each input element.

element = Input(element : Element)
parameters = Element.Parameters(element)
string_from_object = FromObject(parameters)
code_block = CodeBlock { "Family :"; }
contains = String.Contains(str=string_from_object, searchFor=code_block)
filterByBoolMask = List.FilterByBoolMask(list=string_from_object, mask=contains)
code_block_2 = CodeBlock { 0; }
getItemAtIndex = List.GetItemAtIndex(index=code_block_2)
map = List.Map(list=filterByBoolMask.in, f_x=getItemAtIndex)
code_block_3 = CodeBlock { "Family : "; }
split = String.Split(map, code_block_3)
flatten = Flatten(split)
trimWhitespace = String.TrimWhitespace(flatten)
uniqueItems = List.UniqueItems(trimWhitespace)
clean = Custom[Output.Clean](input=uniqueItems)  # This will return a single value or list from one input.
str = Output(clean)
