# Dynamo custom node Element.SetMultipleParametersByName.dyf (Dynamo 0.9.0.3067)
# category: Rhythm.Revit.Elements.Element
# Set multiple (comma seperated) parameters by name.

element = Input(element : var[]..[])
parameterName = Input(parameterName : string)
code_block = CodeBlock { ","; }
split = String.Split(parameterName, code_block)
value = Input(value : var[]..[])
split_2 = String.Split(value, code_block)
setParameterByName = Element.SetParameterByName(element=element, parameterName=split, value=split_2)
flatten = Flatten(setParameterByName)
element_2 = Output(flatten)  # "element"
