# Dynamo custom node Element.Type.dyf (Dynamo 1.0.0.1180)
# category: Rhythm.Revit.Elements.Element.Query
# This retrieves the element type of the given elements. (if available) Similar to others available but no python here.

element = Input()
code_block = CodeBlock { "Type"; }
getParameterValueByName = Element.GetParameterValueByName(element=element, parameterName=code_block)
elementType = Output(getParameterValueByName)
