# Dynamo custom node GetParameterValueByName(TypeOrInstance).dyf (Dynamo 1.2.0.2690)
# category: Rhythm.Revit.Elements.Element.Actions
# Gets a parameter value by name regardless of type or instance.

element = Input()
code_block = CodeBlock(item=element) { Flatten({item}); }
parameterName = Input()
getParameterValueByName = Element.GetParameterValueByName(element=code_block, parameterName=parameterName)
code_block_2 = CodeBlock { ""; }
eq = getParameterValueByName == code_block_2
type = Custom[Element.Type](element=code_block)  # This retrieves the element type of the given elements. (if available) Similar to others available but no python here.
getParameterValueByName_2 = Element.GetParameterValueByName(element=type, parameterName=parameterName)
if_ = If(test=eq, true=getParameterValueByName_2, false=getParameterValueByName)
var = Output(if_)  # "var[]..[]"
