# Dynamo custom node List.AllIndicesOf.dyf (Dynamo 0.8.1.1823)
# category: Rhythm.Core.List
# Given an item, returns the zero-based indices of all its occurrences in the list. If the item cannot be found, an empty list is returned.

list = Input(list : var[]..[])
indices = Input(indices : var[]..[])
eq = list == indices
getKeys = GetKeys(eq)
filterByBoolMask = List.FilterByBoolMask(list=getKeys, mask=eq)
var = Output(filterByBoolMask.in)  # "var[]..[]"
