# Dynamo custom node List.ArchitecturalAlphabeticalSequence.dyf (Dynamo 0.8.2.2392)
# category: Rhythm.Core.List.Create
# This creates a list of characters. What's different is we typically exclude I's and O's from our characters.

amount = Input(amount : int)
boolean = BoolSelector(true)

# group: Builds an alphabetical list that excludes the i's and o's. Currently supports signle letters all the way up to double (600 total)
code_block = CodeBlock { "abcdefghjklmnpqrstuvwxyz"; ""; }
split = String.Split(code_block.out0, code_block.out1)
add = _ + split
map = List.Map(list=split, f_x=add)
create = List.Create(split, map)
flatten = Flatten(create)
takeItems = List.TakeItems(list=flatten, amount=amount)
changeCase = String.ChangeCase(takeItems, boolean)

clean = Custom[Output.Clean](input=changeCase)  # This will return a single value or list from one input.
seq = Output(clean)
