# Dynamo custom node List.GetItemIndices.dyf (Dynamo 0.7.5.3566)
# category: Rhythm.Core.List.Actions
# This node searches the input list for the given string or number.

List = Input()
code_block = CodeBlock(item=List) { Flatten({item}); }
Item = Input()
python_script = Python(IN[0]=code_block, IN[1]=Item)
# ---------- python_script.python (2 lines) ----------
indices = [i for i, x in enumerate(IN[0]) if x == IN[1]]
OUT = indices
# ----------------------------------------
Index_Indices = Output(python_script)  # "Index/Indices"
