# Dynamo custom node List.MergeSublists.dyf (Dynamo 0.8.0.950)
# category: Rhythm.Core.List.Actions
# This will merge all sublists with or without a character between the strings.

List = Input()
Character = Input()
python_script = Python(IN[0]=List, IN[1]=Character)
# ---------- python_script.python (3 lines) ----------
initial = IN[0]
result = map(IN[1].join, initial)
OUT=result
# ----------------------------------------
OUT = Output(python_script)
