# Dynamo custom node Rhythm.3DRoomTags.dyf (Dynamo 0.9.0.3067)
# category: Rhythm.Tools
# This node will generate 3D room tags for all rooms in the model. (RFA in extra folder in Dynamo download)

ThreeDRoomTag = Input(ThreeDRoomTag : FamilyType)
RunMe = Input(RunMe:bool = false)

# group: Credit for this python script to Nate Miller | Download lunchbox for more awesome stuff like this.
# note: #Copyright(c) 2015, Nathan Miller
# # The Proving Ground, http://theprovingground.org
python_script = Python(IN[0]=RunMe)
# ---------- python_script.python (106 lines) ----------
#Copyright(c) 2015, Nathan Miller
# The Proving Ground, http://theprovingground.org

import clr

# Import RevitAPI
clr.AddReference("RevitAPI")
import Autodesk
from Autodesk.Revit.DB import *

# Import DocumentManager and TransactionManager
clr.AddReference("RevitServices")
import RevitServices
from RevitServices.Persistence import DocumentManager
from RevitServices.Transactions import TransactionManager

# Import ToDSType(bool) extension method
clr.AddReference("RevitNodes")
import Revit
clr.ImportExtensions(Revit.Elements)
clr.ImportExtensions(Revit.GeometryConversion)

import clr
clr.AddReference('ProtoGeometry')
from Autodesk.DesignScript.Geometry import *

#The input to this node will be stored in the IN[0] variable.

doc =  DocumentManager.Instance.CurrentDBDocument
app =  DocumentManager.Instance.CurrentUIApplication.Application

toggle = IN[0]

output = []
rooms = []
names = []
numbers = []
areas = []
levels = []
boundaries = []
locations = []
elementids = []
uniqueids = []

if toggle == True:

	collector = FilteredElementCollector(doc)
	collector.OfCategory(BuiltInCategory.OST_Rooms)
 
	famtypeitr = collector.GetElementIdIterator()
	famtypeitr.Reset()


	for item in famtypeitr:
		elmID = item
		eleminst = doc.GetElement(elmID)
    
		#print eleminst
		if eleminst.Area > 0:
			room = eleminst
			roomname = ''
			for p in room.Parameters:
				if p.Definition.Name == 'Name':		
					roomname = p.AsString()
				if p.Definition.Name == 'Level':				
					level = p.AsValueString()
					
			number = eleminst.Number
			area = eleminst.Area
			
			location = eleminst.Location.Point.ToPoint()
			elementid = eleminst.Id.ToString()
			uniqueid = eleminst.UniqueId
    	
			boptions = Autodesk.Revit.DB.SpatialElementBoundaryOptions()
			boundsegs = room.GetBoundarySegments(boptions)
			boundcurves = []
			for bound in boundsegs:
				crvs = []
				for seg in bound:
					crv = seg.Curve
					crvs.append(Revit.GeometryConversion.RevitToProtoCurve.ToProtoType( crv, True ))
				boundcurves.append(crvs)
    	
			rooms.append(room)
			names.append(roomname)
			numbers.append(number)
			areas.append(area)
			levels.append(level)
			boundaries.append(boundcurves)
			locations.append(location)
			elementids.append(elementid)
			uniqueids.append(uniqueid)
        
	output.append(rooms)
	output.append(names)
	output.append(numbers)
	output.append(areas)
	output.append(levels)
	output.append(locations)
	output.append(boundaries)	
	output.append(elementids)
	output.append(uniqueids)
        
#Assign your output to the OUT variable
OUT = output
# ----------------------------------------
code_block = CodeBlock(x=python_script) { x[1]; x[2]; x[5]; }

byPoint = FamilyInstance.ByPoint(familyType=ThreeDRoomTag, point=code_block.out2)
code_block_2 = CodeBlock { "Name"; "Number"; }
setParameterByName = Element.SetParameterByName(element=byPoint, parameterName=code_block_2.out1, value=code_block.out1)
setParameterByName_2 = Element.SetParameterByName(element=byPoint, parameterName=code_block_2.out0, value=code_block.out0)
clean = Custom[Output.Clean](input=setParameterByName_2)  # This will return a single value or list from one input.
ThreeDRoomTags = Output(clean)
