# Dynamo custom node Rhythm.OverrideInteriorCrop.dyf (Dynamo 1.2.3.573)
# category: Rhythm.Tools
# This node will override the lineweight of the crop region on interior elevations. This node would not be possible without the power of the Dynamo community. Specifically Danny Jones with Clark Patterson Lee.

categories = Categories("Views")
all_elements_of_category = ElementsOfCategory(categories)
RunMe = Input(RunMe : bool=false)
toggle = Custom[Rhythm.Toggle](list=all_elements_of_category, boolean=RunMe)  # Toggle that offers two outputs. Created for Dynamo 0.8.1 because of changes to the "IF" node
type = Custom[Element.Type](element=toggle.in)  # This retrieves the element type of the given elements. (if available) Similar to others available but no python here.
string_from_object = FromObject(type)
interiorElevationNamesContain = Input(interiorElevationNamesContain : string = "interior")
code_block = CodeBlock { true; }
contains = String.Contains(str=string_from_object, searchFor=interiorElevationNamesContain, ignoreCase=code_block)
filterByBoolMask = List.FilterByBoolMask(list=toggle.in, mask=contains)
code_block_2 = CodeBlock { "Crop Region Visible"; }
code_block_3 = CodeBlock { 1; }
setParameterByName = Element.SetParameterByName(element=filterByBoolMask.in, parameterName=code_block_2, value=code_block_3)
getCropRegion = Custom[InteriorElevation.GetCropRegion](interiorElevations=setParameterByName)  # This will obtain the crop region from an Interior Elevation View Type.
Lineweight = Input()
python_script = Python(IN[0]=getCropRegion, IN[1]=Lineweight, IN[2]=filterByBoolMask.in)
# ---------- python_script.python (53 lines) ----------
#Copyright(c) 2016, John Pierson
# @60secondrevit, sixtysecondrevit@gmail.com
import clr
# Import ToDSType(bool) extension method
clr.AddReference("RevitNodes")
import Revit
clr.ImportExtensions(Revit.Elements)
# Import DocumentManager and TransactionManager
clr.AddReference("RevitServices")
import RevitServices
from RevitServices.Persistence import DocumentManager
from RevitServices.Transactions import TransactionManager

from System.Collections.Generic import *

# Import RevitAPI
clr.AddReference("RevitAPI")
import Autodesk

doc = DocumentManager.Instance.CurrentDBDocument
uiapp = DocumentManager.Instance.CurrentUIApplication
app = uiapp.Application

#The inputs to this node will be stored as a list in the IN variable.
dataEnteringNode = IN

#unwrap all elements to use with API
elements = []
for i in IN[0]:
	elements.append(UnwrapElement(i))

#create graphic overrides properties
gSettings = Autodesk.Revit.DB.OverrideGraphicSettings()

#set Projection Line weight
gSettings.SetProjectionLineWeight(IN[1])

views = UnwrapElement(IN[2])

# "Start" the transaction
TransactionManager.Instance.EnsureInTransaction(doc)

#apply lineweight override to elements in an input list
for i in elements:
	id = i.Id
	for j in views:
		j.SetElementOverrides(id, gSettings)

# "End" the transaction
TransactionManager.Instance.TransactionTaskDone()

#Assign your output to the OUT variable
OUT = IN[0]
# ----------------------------------------
Modified = Output(python_script)
