# Dynamo custom node Rhythm.RenumberGridsByCurve.dyf (Dynamo 1.2.1.3083)
# category: Rhythm.Tools
# This node will renumber grids in order of curve drawn through them. Select either letters or numbers. (Alphanumeric coming soon)

modelCurve = Input()
select_grids_by_curve = Custom[Select Grids By Curve](modelCurve=modelCurve)  # This will select Revit grids by the input Revit curve,
RunMe = Input(RunMe : bool = false)
toggle = Custom[Rhythm.Toggle](list=select_grids_by_curve, boolean=RunMe)  # Toggle that offers two outputs. Created for Dynamo 0.8.1 because of changes to the "IF" node
string = StringInput("Name")
startCharacter = Input()
count = Count(toggle.in)
code_block = CodeBlock(startCharacter=startCharacter, total=count) { startCharacter..#total..1; 9000..#total..1; }
string_from_object = FromObject(code_block.out1)
setParameterByName = Element.SetParameterByName(element=toggle.in, parameterName=string, value=string_from_object)
string_from_object_2 = FromObject(code_block.out0)
setParameterByName_2 = Element.SetParameterByName(element=setParameterByName, parameterName=string, value=string_from_object_2)
code_block_2 = CodeBlock {  }
