# Dynamo custom node Rhythm.TextBoxInput.dyf (Dynamo 1.2.1.3083)
# category: Rhythm.Core.Input
# Provides a text box input for users. Allows for multiple strings if needed.

currentUserAppData = Custom[OS.CurrentUserAppData]()  # This retrieves the current user's appdata location
string = StringInput("\Dynamo\Dynamo Revit\1.2\packages\Rhythm\extra\rhythm-logo-smaller.png")
add = currentUserAppData + string
reset = Input(reset : bool = false)
python_script = Python(IN[0]=add, IN[1]=reset)
# ---------- python_script.python (67 lines) ----------
#Based on the code generously provided at http://zetcode.com/tutorials/ironpythontutorial/controlsII/
#Made for Dynamo by John Pierson
import clr
clr.AddReference("System.Windows.Forms")
clr.AddReference("System.Drawing")

from System.Windows.Forms import Application, Form, StatusBar
from System.Windows.Forms import RadioButton, GroupBox, Label, Button, AnchorStyles, DockStyle, PictureBox, PictureBoxSizeMode, TextBox
from System.Windows.Forms import TrackBar, TickStyle
from System.Drawing import Size, Point, Font, Color, Image

pathToFile = IN[0]

class IForm(Form):

	def __init__(self):

		self.Text = IN[0]

		image = Image.FromFile(pathToFile)
		pictureBox = PictureBox()
		pictureBox.Size = Size(250,110)
		pictureBox.Location = Point(25,0)
		pictureBox.Image = image
		#pictureBox.Dock = DockStyle.Top
        
		self.output1 = []
		self.Font = Font("Arial",12)
		self.BackColor = Color.White

		self.label = Label()
		self.label.Text = "enter your value below"
		self.label.Location = Point(25, 125)
		self.label.Height = 25
		self.label.Width = 175
		self.label.Font = Font("OpenSans",12)

		self.textbox = TextBox()
		self.textbox.Text = ""
		self.textbox.Location = Point(25, 150)
		self.textbox.Width = 250
		self.textbox.Font = Font("OpenSans",10)

		self.button1 = Button()
		self.button1.Text = 'apply and close'
		self.button1.Location = Point(25, 200)
		self.button1.Click += self.update
		self.button1.Width = 250

		self.AcceptButton = self.button1

		self.Controls.Add(self.label)
		self.Controls.Add(self.textbox)
		self.Controls.Add(self.button1)
		self.Controls.Add(pictureBox)
		self.CenterToScreen()
		self.AutoSize = True

	def update(self, sender, event):
		self.label.Text = self.textbox.Text
		self.output1.append(self.textbox.Text)
		self.Close()


form = IForm()
Application.Run(form)
OUT = form.output1
# ----------------------------------------
clean = Custom[Output.Clean](input=python_script)  # This will return a single value or list from one input.
string_2 = Output(clean)  # "string"
