# Dynamo custom node Room Element Collector.dyf (Dynamo 1.2.0.2690)
# category: Rhythm.Tools
# THis will collect data regarding rooms in the active model. Similar to Lunchbox node, but this one does not use python.

categories = Categories("Rooms")
all_elements_of_category = ElementsOfCategory(categories)
RunMe = Input(RunMe : bool = false)
toggle = Custom[Rhythm.Toggle](list=all_elements_of_category, boolean=RunMe)  # Toggle that offers two outputs. Created for Dynamo 0.8.1 because of changes to the "IF" node
name = Room.Name(toggle.in)
Name = Output(name)
number = Room.Number(toggle.in)
Number = Output(number)
getLevelNameAsString = Custom[Element.GetLevelNameAsString](element=toggle.in)  # This retrieves the level name of the input elements as a string. This is in response to a known issue with the get value node.
Level_Name = Output(getLevelNameAsString)
coreBoundary = Room.CoreBoundary(toggle.in)
Boundaries = Output(coreBoundary)
id = Element.Id(toggle.in)
Element_ID = Output(id)
uniqueId = Element.UniqueId(toggle.in)
Unique_ID = Output(uniqueId)
location = Room.Location(toggle.in)
Location = Output(location)
Elements = Output(toggle.in)
