# Dynamo custom node Select Elements By Curve.dyf (Dynamo 0.8.2.2392)
# category: Rhythm.Revit.Selection.Actions
# This will select model elements in order that a curve is drawn through them.

ModelCurve = Input()

# group: Model curve drawn through rooms
curve = CurveElement.Curve(ModelCurve)
code_block = CodeBlock { 400; }
divideEqually = Curve.DivideEqually(curve, code_block)
endPoint = Curve.EndPoint(divideEqually)

flatten = Flatten(endPoint)
Category = Input()
name = Element.Name(Category)
code_block_2 = CodeBlock { "Grids"; }
eq = name == code_block_2
all_elements_of_category = ElementsOfCategory(Category)
RunMe = Input(RunMe : bool)
toggle = Custom[Rhythm.Toggle](list=all_elements_of_category, boolean=RunMe)  # Toggle that offers two outputs. Created for Dynamo 0.8.1 because of changes to the "IF" node
curve_2 = Grid.Curve(toggle.in)
ZAxis = Vector.ZAxis()
code_block_3 = CodeBlock { true; }
level_element_collector = Custom[Level Element Collector](RunMe=code_block_3)  # This collects data for all of the Level elements in the model. Similar to the node on Lunchbox, but this one uses all O.O.B. nodes.
code_block_4 = CodeBlock { "Work Plane"; }
getParameterValueByName = Element.GetParameterValueByName(element=ModelCurve, parameterName=code_block_4)
code_block_5 = CodeBlock { ": "; }
removePriorToCharacter = Custom[String.RemovePriorToCharacter](str=getParameterValueByName, Character=code_block_5)  # This will remove all characters prior to the input character. Accepts strings.
trimWhitespace = String.TrimWhitespace(removePriorToCharacter)
eq_2 = trimWhitespace == level_element_collector.Name
filterByBoolMask = List.FilterByBoolMask(list=level_element_collector.Elevation, mask=eq_2)
extrude = Curve.Extrude(curve=curve_2, direction=ZAxis, distance=filterByBoolMask.in, lacing=Longest)
code_block_6 = CodeBlock { 0.5; }
thicken = Surface.Thicken(surface=extrude, thickness=code_block_6)
boundingBox = Element.BoundingBox(toggle.in)
toCuboid = BoundingBox.ToCuboid(boundingBox)
thisOrThat = Custom[Ayuda.ThisOrThat](Toggle=eq, Item1=thicken, Item2=toCuboid)  # This node is a toggle between two inputs.
doesIntersect = Geometry.DoesIntersect(geometry=thisOrThat)
map = List.Map(list=flatten, f_x=doesIntersect)
filterByBoolMask_2 = List.FilterByBoolMask(list=toggle.in)
map_2 = List.Map(list=map, f_x=filterByBoolMask_2.in)
flatten_2 = Flatten(map_2)
uniqueItems = List.UniqueItems(flatten_2)
count = Count(uniqueItems)
Items = Output(uniqueItems)
