# Dynamo custom node SetParameterByName(TypeOrInstance).dyf (Dynamo 1.2.0.2690)
# category: Rhythm.Revit.Elements.Element.Actions
# Set one of the element's parameters regardless of parameter type or instance.

element = Input()
code_block = CodeBlock(item=element) { Flatten({item}); }
parameterName = Input()
value = Input()
setParameterByName = Element.SetParameterByName(element=code_block, parameterName=parameterName, value=value)
isNull = Object.IsNull(setParameterByName)
type = Custom[Element.Type](element=code_block)  # This retrieves the element type of the given elements. (if available) Similar to others available but no python here.
setParameterByName_2 = Element.SetParameterByName(element=type, parameterName=parameterName, value=value)
if_ = If(test=isNull, true=setParameterByName_2, false=setParameterByName)
Element = Output(if_)
