# Dynamo custom node SquareFeetDropper.dyf (Dynamo 0.7.5.3566)
# category: Rhythm.Core.List.Actions
# This node drops square feet from the pulled area

Values = Input()
length = String.Length(Values)
code_block = CodeBlock { -3; }
remove = String.Remove(Values, length, code_block)
Cleaned = Output(remove)
