# Dynamo custom node UI.UserMessage.dyf (Dynamo 0.9.2.4472)
# category: Rhythm.Revit.UI
# This will display a user message once. Until it is either toggled or changed.

refresh = Input(refresh : bool = false)
userMessage = Input(userMessage : string = "no message")
python_script = Python(IN[0]=refresh, IN[1]=userMessage)
# ---------- python_script.python (22 lines) ----------
import clr
import msvcrt

clr.AddReference("RevitAPIUI")
from  Autodesk.Revit.UI import *

clr.AddReference("RevitServices")
import RevitServices
from RevitServices.Persistence import DocumentManager
doc = DocumentManager.Instance.CurrentDBDocument
uidoc=DocumentManager.Instance.CurrentUIApplication.ActiveUIDocument

clr.AddReference("RevitNodes")
import Revit
clr.ImportExtensions(Revit.Elements)

button = TaskDialogCommonButtons.None
result = TaskDialogResult.Ok
TaskDialog.Show('User Text',IN[1],button)

		
OUT = IN[1]
# ----------------------------------------
message = Output(python_script)
